# Grasshopper definition Rotation 3D.gh (Grasshopper 1.0.7)

curve = Curve([<curve referenced from the Rhino model> x500])
polygon_center = PolygonCenter(Polyline=curve)  # -> CenterV, CenterE, CenterA
yz_plane = YZPlane(Origin=Point(0, 0, 0))
orient_direction = OrientDirection(
    Geometry=curve,
    PointA=polygon_center.CenterV,
    DirectionA=yz_plane,
    PointB=polygon_center.CenterE,
    DirectionB=Vector(0, 0, 1))  # -> Geometry, Transform
loft = Loft(
    Curves=orient_direction.Geometry,
    Options={Adjust=False, Closed=False, LoftEnds=0, LoftSimp=0, LoftType=0, Rebuild=10, Refit=0.01})
